# Grasshopper definition building_generator.gh (Grasshopper 1.0.7)

# ---- group: Transformation rules
ground_floor_rotate_angle = Slider(0, range=-2..2)
ground_floor_scale_factor = Slider(1, range=0.5..1.5)
roof_rotate_angle = Slider(0, range=-2..2)
roof_scale_factor = Slider(1, range=0.5..1.5)

# ----
number_slider = Slider(8, range=3..8)

# ---- group: Genes
building_storey = Slider(20, range=20..30)
floor_height = Slider(5, range=4..6)
ground_floor_geometry = Curve(<curve referenced from the Rhino model>)

# ----
number_slider_2 = Slider(40, range=25..50)
number_slider_3 = Slider(0, range=-20..20)
number_slider_4 = Slider(0, range=-20..20)
number_slider_5 = Slider(0, range=-20..20)
number_slider_6 = Slider(0, range=-20..20)
number_slider_7 = Slider(0, range=-5..5)
number_slider_8 = Slider(0, range=-20..20)
number_slider_9 = Slider(0, range=-20..20)
number_slider_10 = Slider(0, range=-20..20)
number_slider_11 = Slider(0, range=-20..20)
number_slider_12 = Slider(0, range=-20..20)
number_slider_13 = Slider(0, range=-20..20)
number_slider_14 = Slider(0, range=-20..20)
number_slider_15 = Slider(0, range=-20..20)
number_slider_16 = Slider(0, range=-20..20)
number_slider_17 = Slider(0, range=-20..20)
number_slider_18 = Slider(0, range=-20..20)
polygon = Polygon(Plane=PlaneXY(0, 0, 0), Radius=number_slider_2, Segments=number_slider, FilletRadius=0)  # -> Polygon, Length

# ---- group: Gorund floor center point
ground_floor_geometry_2 = Curve(ground_floor_geometry)
topoly = CurveToPolyline(Curve=ground_floor_geometry_2, ToleranceDistance=0, ToleranceAngle=0)  # -> Polyline, Segments
pcen = PolygonCenter(Polyline=topoly.Polyline)  # -> CenterV, CenterE, CenterA
gf_center_point = Point(pcen.CenterV)

# ----
crv = Curve(polygon.Polygon)

# ---- group: Building height
building_storey_2 = Number(building_storey)
floor_height_2 = Number(floor_height)
multiplication = Multiplication(BuildingStorey=building_storey_2, FloorHeight=floor_height_2)
building_height = Number(multiplication)
panel = Panel(building_height)

# ----
explode = Explode(Curve=crv, Recursive=True)  # -> Segments, Vertices
item = ListItem(List=explode.Vertices, Index=Slider(5, range=1..8), Wrap=True)
item_2 = ListItem(List=explode.Vertices, Index=Slider(6, range=1..8), Wrap=True)
vec = VectorXYZ(XComponent=number_slider_3, YComponent=number_slider_14, ZComponent=0)  # -> Vector, Length
vec_2 = VectorXYZ(XComponent=number_slider_4, YComponent=number_slider_15, ZComponent=0)  # -> Vector, Length
item_3 = ListItem(List=explode.Vertices, Index=Slider(8, range=1..8), Wrap=True)
item_4 = ListItem(List=explode.Vertices, Index=Slider(4, range=1..8), Wrap=True)
item_5 = ListItem(List=explode.Vertices, Index=Slider(1, range=1..8), Wrap=True)
item_6 = ListItem(List=explode.Vertices, Index=Slider(7, range=1..8), Wrap=True)
item_7 = ListItem(List=explode.Vertices, Index=Slider(2, range=1..8), Wrap=True)
vec_3 = VectorXYZ(XComponent=number_slider_10, YComponent=number_slider_17, ZComponent=0)  # -> Vector, Length
item_8 = ListItem(List=explode.Vertices, Index=Slider(3, range=1..8), Wrap=True)
vec_4 = VectorXYZ(XComponent=number_slider_8, YComponent=number_slider_16, ZComponent=0)  # -> Vector, Length
vec_5 = VectorXYZ(XComponent=number_slider_6, YComponent=number_slider_5, ZComponent=0)  # -> Vector, Length
vec_6 = VectorXYZ(XComponent=number_slider_13, YComponent=number_slider_18, ZComponent=0)  # -> Vector, Length
vec_7 = VectorXYZ(XComponent=number_slider_9, YComponent=number_slider_7, ZComponent=0)  # -> Vector, Length
vec_8 = VectorXYZ(XComponent=number_slider_12, YComponent=number_slider_11, ZComponent=0)  # -> Vector, Length
move = Move(Geometry=item, Motion=vec.Vector)  # -> Geometry, Transform
move_2 = Move(Geometry=item_2, Motion=vec_2.Vector)  # -> Geometry, Transform
move_3 = Move(Geometry=item_3, Motion=vec_3.Vector)  # -> Geometry, Transform
move_4 = Move(Geometry=item_4, Motion=vec_4.Vector)  # -> Geometry, Transform
move_5 = Move(Geometry=item_5, Motion=vec_5.Vector)  # -> Geometry, Transform
move_6 = Move(Geometry=item_6, Motion=vec_6.Vector)  # -> Geometry, Transform
move_7 = Move(Geometry=item_7, Motion=vec_7.Vector)  # -> Geometry, Transform
move_8 = Move(Geometry=item_8, Motion=vec_8.Vector)  # -> Geometry, Transform
panel_2 = Panel(item_5)
merge = Merge(
    Data1=move_5.Geometry,
    Data2=move_7.Geometry,
    Data3=move_8.Geometry,
    Data4=move_4.Geometry,
    Data5=move.Geometry,
    Data6=move_2.Geometry,
    Data7=move_6.Geometry,
    Data8=move_3.Geometry)

# ---- group: Ground floor geometry scale
gf_center_point_2 = Point(gf_center_point)
ground_floor_scale_factor_2 = Number(ground_floor_scale_factor)
gf_geometry = Curve(ground_floor_geometry)
scale = Scale(Geometry=gf_geometry, Center=gf_center_point_2, Factor=ground_floor_scale_factor_2)  # -> Geometry, Transform

# ---- group: Roof center point
building_height_2 = Number(panel)
gf_center_point_3 = Point(gf_center_point)
Z = UnitZ(Factor=building_height_2)
move_9 = Move(Geometry=gf_center_point_3, Motion=Z)  # -> Geometry, Transform

# ----
galapagos = Galapagos(
    fitness=total_area_4,
    gene=[number_slider, number_slider_2, number_slider_6, number_slider_5, number_slider_9, number_slider_7, number_slider_12, number_slider_11, number_slider_8, number_slider_16, building_storey_3, floor_height_3, roof_rotate_angle_3, roof_scale_factor_3, ground_floor_rotate_angle_2, ground_floor_scale_factor_3, number_slider_3, number_slider_14, number_slider_4, number_slider_15, number_slider_13, number_slider_18, number_slider_10, number_slider_17, number_slider_19])

# ---- group: Roof geometry
building_height_3 = Number(panel)
ground_floor_geometry_3 = Curve(ground_floor_geometry)
Z_2 = UnitZ(Factor=building_height_3)
move_10 = Move(Geometry=ground_floor_geometry_3, Motion=Z_2)  # -> Geometry, Transform

# ---- group: Roof geometry scale
roof_center_point = Point(move_9.Geometry)
roof_scale_factor_2 = Number(roof_scale_factor)
roof_geometry = Curve(move_10.Geometry)
scale_2 = Scale(Geometry=roof_geometry, Center=roof_center_point, Factor=roof_scale_factor_2)  # -> Geometry, Transform

# ----
pline = PolyLine(Vertices=merge, Closed=False)
len = Length(Curve=pline)
panel_3 = Panel(len)
number_slider_19 = Slider(1, range=1..10)
intcrv = Interpolate(Vertices=merge, Degree=number_slider_19, Periodic=Toggle(True), KnotStyle=1)  # -> Curve, Length, Domain

# ---- group: Roof geometry rotate
roof_rotate_angle_2 = Number(roof_rotate_angle)
roof_plane = Plane(move_9.Geometry)
rotate = Rotate(Geometry=scale_2.Geometry, Angle=roof_rotate_angle_2, Plane=roof_plane)  # -> Geometry, Transform

# ---- group: Ground floor geometry rotate
gf_center_point_4 = Point(gf_center_point)
gf_rotate_angle = Number(ground_floor_rotate_angle)
rotate_2 = Rotate(Geometry=scale.Geometry, Angle=gf_rotate_angle, Plane=gf_center_point_4)  # -> Geometry, Transform

# ---- group: Transformation rules
ground_floor_rotate_angle_2 = Slider(0, range=-2..2)
ground_floor_scale_factor_3 = Slider(1, range=0.5..1.5)
roof_rotate_angle_3 = Slider(0, range=-2..2)
roof_scale_factor_3 = Slider(1, range=0.5..1.5)

# ---- group: Building mass
ground_floor = Curve(rotate_2.Geometry)
roof = Curve(rotate.Geometry)
loft = Loft(
    Curves=[roof, ground_floor],
    Options={Adjust=False, Closed=False, LoftEnds=0, LoftSimp=0, LoftType=0, Rebuild=10, Refit=0.01})
cap = CapHoles(Brep=loft)
preview = CustomPreview(Geometry=cap, Material=ColourSwatch(SwatchColor=RGB(176, 255, 229)))

# ---- group: Genes
building_storey_3 = Slider(20, range=20..30)
floor_height_3 = Slider(5, range=4..6)
ground_floor_geometry_4 = Curve(intcrv.Curve)

# ---- group: Gorund floor center point
ground_floor_geometry_5 = Curve(ground_floor_geometry_4)
topoly_2 = CurveToPolyline(Curve=ground_floor_geometry_5, ToleranceDistance=0, ToleranceAngle=0)  # -> Polyline, Segments
pcen_2 = PolygonCenter(Polyline=topoly_2.Polyline)  # -> CenterV, CenterE, CenterA
gf_center_point_5 = Point(pcen_2.CenterV)

# ---- group: Building height
building_storey_4 = Number(building_storey_3)
floor_height_4 = Number(floor_height_3)
multiplication_2 = Multiplication(BuildingStorey=building_storey_4, FloorHeight=floor_height_4)
building_height_4 = Number(multiplication_2)
panel_4 = Panel(building_height_4)

# ---- group: Ground floor geometry scale
gf_center_point_6 = Point(gf_center_point_5)
ground_floor_scale_factor_4 = Number(ground_floor_scale_factor_3)
gf_geometry_2 = Curve(ground_floor_geometry_4)
scale_3 = Scale(Geometry=gf_geometry_2, Center=gf_center_point_6, Factor=ground_floor_scale_factor_4)  # -> Geometry, Transform

# ---- group: Roof center point
building_height_5 = Number(panel_4)
gf_center_point_7 = Point(gf_center_point_5)
Z_3 = UnitZ(Factor=building_height_5)
move_11 = Move(Geometry=gf_center_point_7, Motion=Z_3)  # -> Geometry, Transform

# ---- group: Roof geometry
building_height_6 = Number(panel_4)
ground_floor_geometry_6 = Curve(ground_floor_geometry_4)
Z_4 = UnitZ(Factor=building_height_6)
move_12 = Move(Geometry=ground_floor_geometry_6, Motion=Z_4)  # -> Geometry, Transform

# ---- group: Roof geometry scale
roof_center_point_2 = Point(move_11.Geometry)
roof_scale_factor_4 = Number(roof_scale_factor_3)
roof_geometry_2 = Curve(move_12.Geometry)
scale_4 = Scale(Geometry=roof_geometry_2, Center=roof_center_point_2, Factor=roof_scale_factor_4)  # -> Geometry, Transform

# ---- group: Roof geometry rotate
roof_rotate_angle_4 = Number(roof_rotate_angle_3)
roof_plane_2 = Plane(move_11.Geometry)
rotate_3 = Rotate(Geometry=scale_4.Geometry, Angle=roof_rotate_angle_4, Plane=roof_plane_2)  # -> Geometry, Transform

# ---- group: Ground floor geometry rotate
gf_center_point_8 = Point(gf_center_point_5)
gf_rotate_angle_2 = Number(ground_floor_rotate_angle_2)
rotate_4 = Rotate(Geometry=scale_3.Geometry, Angle=gf_rotate_angle_2, Plane=gf_center_point_8)  # -> Geometry, Transform

# ---- group: Building mass
ground_floor_2 = Curve(rotate_4.Geometry)
roof_2 = Curve(rotate_3.Geometry)
loft_2 = Loft(
    Curves=[roof_2, ground_floor_2],
    Options={Adjust=False, Closed=False, LoftEnds=0, LoftSimp=0, LoftType=0, Rebuild=10, Refit=0.01})
cap_2 = CapHoles(Brep=loft_2)
preview_2 = CustomPreview(Geometry=cap_2, Material=ColourSwatch(SwatchColor=RGB(163, 255, 224)))

# ----
pipe = Pipe(Radius=Slider(0.5, range=0..1.5), Caps=0)
preview_3 = CustomPreview(Geometry=pipe, Material=ColourSwatch(SwatchColor=RGB(25, 140, 117)))

# ---- group: Ground floor area
ground_floor_geometry_7 = Curve(ground_floor_geometry)
area = Area(Geometry=ground_floor_geometry_7)  # -> BuildingArea, Centroid

# ----
building_area = Number(area.BuildingArea)

# ---- group: Ground floor area (continued)
panel_5 = Panel(building_area)

ground_floor_geometry_8 = Curve(ground_floor_geometry_4)
area_2 = Area(Geometry=ground_floor_geometry_8)  # -> BuildingArea, Centroid

# ----
building_area_2 = Number(area_2.BuildingArea)

# ---- group: Ground floor area (continued)
panel_6 = Panel(building_area_2)

# ---- group: Floors
building_mass = Brep(cap)
floor_height_5 = Number(floor_height)
contour = Contour(Shape=building_mass, Point=Point(0, 0, 0), Direction=Vector(0, 0, 1), Distance=floor_height_5)  # -> flatten(Contours)
area_3 = Area(Geometry=contour)  # -> Area, Centroid
ma = MassAddition(Input=area_3.Area)  # -> Result, PartialResults
panel_7 = Panel(area_3.Area)

# ----
total_area = Number(ma.Result)
total_area_2 = Number(total_area)
int = Integer(total_area_2)
panel_8 = Panel(int)

# ---- group: Floors (continued)
panel_9 = Panel(total_area)

building_mass_2 = Brep(cap_2)
floor_height_6 = Number(floor_height_3)
contour_2 = Contour(Shape=building_mass_2, Point=Point(0, 0, 0), Direction=Vector(0, 0, 1), Distance=floor_height_6)  # -> flatten(Contours)
area_4 = Area(Geometry=contour_2)  # -> Area, Centroid
ma_2 = MassAddition(Input=area_4.Area)  # -> Result, PartialResults
panel_10 = Panel(area_4.Area)

# ----
total_area_3 = Number(ma_2.Result)
total_area_4 = Number(total_area_3)
int_2 = Integer(total_area_4)
panel_11 = Panel(int_2)

# ---- group: Floors (continued)
panel_12 = Panel(total_area_3)
