# Grasshopper definition env_creator.gh (Grasshopper 1.0.7)

swatch = ColourSwatch(SwatchColor=RGB(255, 241, 219))

# ---- group: Road
crv = Curve(<curve referenced from the Rhino model>)
crv_2 = Curve([<curve referenced from the Rhino model> x3])
srf = Surface(crv)
srf_2 = Surface(crv_2)
rdiff = RegionDifference(CurvesA=srf, CurvesB=srf_2)
boundary = BoundarySurfaces(Edges=rdiff)
preview = CustomPreview(Geometry=boundary, Material=ColourSwatch(SwatchColor=RGB(140, 140, 140)))

# ---- group: Building_1
crv_3 = Curve([<curve referenced from the Rhino model> x62])
Z = UnitZ(Factor=4)
srf_3 = Surface(crv_3)
extr = Extrude(Base=srf_3, Direction=Z)
preview_2 = CustomPreview(Geometry=extr, Material=swatch)

# ---- group: Building_2
crv_4 = Curve([<curve referenced from the Rhino model> x8])
Z_2 = UnitZ(Factor=12)
srf_4 = Surface(crv_4)
extr_2 = Extrude(Base=srf_4, Direction=Z_2)
preview_3 = CustomPreview(Geometry=extr_2, Material=swatch)

crv_5 = Curve(<curve referenced from the Rhino model>)
Z_3 = UnitZ(Factor=80)
srf_5 = Surface(crv_5)
extr_3 = Extrude(Base=srf_5, Direction=Z_3)
preview_4 = CustomPreview(Geometry=extr_3, Material=swatch)
