# Grasshopper definition form_generator.gh (Grasshopper 1.0.7)

# ---- group: Block
material = CreateMaterial(
    Diffuse=ColourSwatch(SwatchColor=RGB(230, 230, 230)),
    Specular=RGB(255, 255, 255),
    Emission=RGB(0, 0, 0),
    Transparency=Slider(0.4, range=0..1),
    Shine=0)

# ---- group: Block / Road
crv = Curve(<curve referenced from the Rhino model>)
crv_2 = Curve([<curve referenced from the Rhino model> x3])
srf = Surface(crv)
srf_2 = Surface(crv_2)
rdiff = RegionDifference(CurvesA=srf, CurvesB=srf_2)
boundary = BoundarySurfaces(Edges=rdiff)
Z = UnitZ(Factor=0.1)
move = Move(Geometry=boundary, Motion=Z)  # -> Geometry, Transform
preview = CustomPreview(Geometry=move.Geometry, Material=ColourSwatch(SwatchColor=RGB(140, 140, 140)))

# ---- group: Block / Building_1
crv_3 = Curve([<curve referenced from the Rhino model> x60])
Z_2 = UnitZ(Factor=4)
srf_3 = Surface(crv_3)
extr = Extrude(Base=srf_3, Direction=Z_2)
preview_2 = CustomPreview(Geometry=extr, Material=material)

# ---- group: Block / Grass
crv_4 = Curve(<curve referenced from the Rhino model>)
srf_4 = Surface(crv_4)
preview_3 = CustomPreview(Geometry=srf_4, Material=ColourSwatch(SwatchColor=RGB(221, 255, 214)))

# ---- group: Block / Building_2
crv_5 = Curve([<curve referenced from the Rhino model> x8])
Z_3 = UnitZ(Factor=12)
srf_5 = Surface(crv_5)
extr_2 = Extrude(Base=srf_5, Direction=Z_3)
preview_4 = CustomPreview(Geometry=extr_2, Material=material)

# ---- group: Block / Building_3
crv_6 = Curve(<curve referenced from the Rhino model>)
Z_4 = UnitZ(Factor=70)
srf_6 = Surface(crv_6)
extr_3 = Extrude(Base=srf_6, Direction=Z_4)
preview_5 = CustomPreview(Geometry=extr_3, Material=material)

# ---- group: Ground floor geometry
crv_7 = Curve(<curve referenced from the Rhino model>)
explode = Explode(Curve=crv_7, Recursive=True)  # -> Segments, Vertices
pt = Point(graft(explode.Vertices))
bang = ExplodeTree(Data=pt)  # -> Branch0, Branch1, Branch2, Branch3, Branch4
pt_2 = Point(flatten(bang.Branch0))
pt_3 = Point(flatten(bang.Branch1))
pt_4 = Point(flatten(bang.Branch2))
pt_5 = Point(flatten(bang.Branch3))
pt_6 = Point(flatten(pt_2))
merge = Merge(Data1=pt_2, Data2=pt_3, Data3=pt_4, Data4=pt_5, Data5=pt_6)
pline = PolyLine(Vertices=merge, Closed=False)

# ----
area = Area(Geometry=crv_7)  # -> Area, Centroid
panel = Panel(area.Area)
galapagos = Galapagos(fitness=num_3, gene=[south_vert, east_vert, north_vert, south_horz, north_horz, east_horz, west_vert, west_horz])

# ---- group: Genes
ground_floor_geometry = Curve(pline)

# ---- group: Basic
building_storey = Slider(20, range=15..20)
floor_height = Slider(4, range=4..6)

# ----
num = Number(20)
num_2 = Number(4)

# ---- group: Building height
building_storey_2 = Number(building_storey)
floor_height_2 = Number(floor_height)
multiplication = Multiplication(BuildingStorey=building_storey_2, FloorHeight=floor_height_2)
building_height = Number(multiplication)
panel_2 = Panel(building_height)

# ---- group: Ground floor area
ground_floor_geometry_2 = Curve(ground_floor_geometry)
area_2 = Area(Geometry=ground_floor_geometry_2)  # -> BuildingArea, Centroid
building_area = Number(area_2.BuildingArea)
panel_3 = Panel(building_area)

# ---- group: Line
north_horz = Slider(0, range=-20..20)
north_vert = Slider(-10, range=-20..20)
south_horz = Slider(0, range=-20..20)
south_vert = Slider(-10, range=-20..20)
west_horz = Slider(0, range=-20..10)
west_vert = Slider(0, range=-20..10)
east_horz = Slider(0, range=-20..10)
east_vert = Slider(0, range=-20..10)

# ---- group: Point
vec = VectorXYZ(XComponent=Slider(0, range=-20..20), YComponent=Slider(0, range=-20..20), ZComponent=Slider(0, range=-20..20))  # -> Vector, Length
vec_2 = VectorXYZ(XComponent=Slider(0, range=-20..20), YComponent=Slider(0, range=-20..20), ZComponent=Slider(0, range=-20..20))  # -> Vector, Length
vec_3 = VectorXYZ(XComponent=Slider(0, range=-20..20), YComponent=Slider(0, range=-20..20), ZComponent=Slider(0, range=-20..20))  # -> Vector, Length
vec_4 = VectorXYZ(XComponent=Slider(0, range=-20..20), YComponent=Slider(0, range=-20..20), ZComponent=Slider(0, range=-20..20))  # -> Vector, Length

# ---- group: Roof geometry
building_height_2 = Number(panel_2)
ground_floor_geometry_3 = Curve(ground_floor_geometry)
Z_5 = UnitZ(Factor=building_height_2)
move_2 = Move(Geometry=ground_floor_geometry_3, Motion=Z_5)  # -> Geometry, Transform

# ---- group: Explode roof geometry
crv_8 = Curve(move_2.Geometry)
explode_2 = Explode(Curve=crv_8, Recursive=True)  # -> Segments, Vertices
pt_7 = Point(graft(explode_2.Vertices))
bang_2 = ExplodeTree(Data=pt_7)  # -> Branch0, Branch1, Branch2, Branch3, Branch4
pt_8 = Point(flatten(bang_2.Branch0))
pt_9 = Point(flatten(bang_2.Branch1))
pt_10 = Point(flatten(bang_2.Branch3))
pt_11 = Point(flatten(bang_2.Branch2))

# ---- group: Expand
pt_12 = Point(pt_11)
pt_13 = Point(pt_10)
pt_14 = Point(pt_8)
pt_15 = Point(pt_9)
merge_2 = Merge(Data1=pt_14, Data2=pt_15, Data3=pt_12, Data4=pt_13, Data5=pt_14)
pline_2 = PolyLine(Vertices=merge_2, Closed=False)
pt_16 = Point(pt_13)
pt_17 = Point(pt_12)
pt_18 = Point(pt_14)
pt_19 = Point(pt_15)
vec_5 = VectorXYZ(XComponent=0, YComponent=north_horz, ZComponent=north_vert)  # -> Vector, Length
vec_6 = VectorXYZ(XComponent=0, YComponent=south_horz, ZComponent=south_vert)  # -> Vector, Length
move_3 = Move(Geometry=pt_18, Motion=vec_5.Vector)  # -> Geometry, Transform
move_4 = Move(Geometry=pt_19, Motion=vec_5.Vector)  # -> Geometry, Transform
move_5 = Move(Geometry=pt_17, Motion=vec_6.Vector)  # -> Geometry, Transform
move_6 = Move(Geometry=pt_16, Motion=vec_6.Vector)  # -> Geometry, Transform
vec_7 = VectorXYZ(XComponent=east_horz, YComponent=0, ZComponent=east_vert)  # -> Vector, Length
vec_8 = VectorXYZ(XComponent=west_horz, YComponent=0, ZComponent=west_vert)  # -> Vector, Length
move_7 = Move(Geometry=move_3.Geometry, Motion=vec_8.Vector)  # -> Geometry, Transform
move_8 = Move(Geometry=move_4.Geometry, Motion=vec_7.Vector)  # -> Geometry, Transform
move_9 = Move(Geometry=move_5.Geometry, Motion=vec_7.Vector)  # -> Geometry, Transform
move_10 = Move(Geometry=move_6.Geometry, Motion=vec_8.Vector)  # -> Geometry, Transform
move_11 = Move(Geometry=[move_7.Geometry, move_10.Geometry], Motion=Vector(0, 0, 10))  # -> graft(Geometry), Transform
move_12 = Move(Geometry=[move_7.Geometry, move_8.Geometry], Motion=Vector(0, 0, 10))  # -> graft(Geometry), Transform
move_13 = Move(Geometry=[move_8.Geometry, move_9.Geometry], Motion=Vector(0, 0, 10))  # -> graft(Geometry), Transform
move_14 = Move(Geometry=[move_9.Geometry, move_10.Geometry], Motion=Vector(0, 0, 10))  # -> graft(Geometry), Transform
bang_3 = ExplodeTree(Data=move_11.Geometry)  # -> flatten(Branch0), Branch1
bang_4 = ExplodeTree(Data=move_12.Geometry)  # -> Branch0, flatten(Branch1)
bang_5 = ExplodeTree(Data=move_13.Geometry)  # -> Branch0, flatten(Branch1)
bang_6 = ExplodeTree(Data=move_14.Geometry)  # -> Branch0, flatten(Branch1)
ln = Line(StartPoint=bang_4.Branch0, EndPoint=bang_4.Branch1)
ln_2 = Line(StartPoint=bang_6.Branch0, EndPoint=bang_6.Branch1)
ln_3 = Line(StartPoint=bang_3.Branch0, EndPoint=bang_3.Branch1)
ln_4 = Line(StartPoint=bang_5.Branch0, EndPoint=bang_5.Branch1)
pline_3 = PolyLine(Vertices=[bang_3.Branch0, bang_4.Branch1, bang_5.Branch1, bang_6.Branch1], Closed=True)
crv_9 = Curve(pline_3)

# ---- group: Explode roof geometry
crv_10 = Curve(crv_9)
explode_3 = Explode(Curve=crv_10, Recursive=True)  # -> Segments, Vertices
pt_20 = Point(graft(explode_3.Vertices))
bang_7 = ExplodeTree(Data=pt_20)  # -> Branch0, Branch1, Branch2, Branch3, Branch4
pt_21 = Point(flatten(bang_7.Branch0))
pt_22 = Point(flatten(bang_7.Branch3))
pt_23 = Point(flatten(bang_7.Branch1))
pt_24 = Point(flatten(bang_7.Branch2))

# ---- group: Roof geometry
pt_25 = Point(pt_21)
pt_26 = Point(pt_23)
pt_27 = Point(pt_24)
pt_28 = Point(pt_22)
Z_6 = UnitZ(Factor=1)
Z_7 = UnitZ(Factor=1)
Z_8 = UnitZ(Factor=1)
Z_9 = UnitZ(Factor=1)
move_15 = Move(Geometry=pt_25, Motion=Z_6)  # -> Geometry, Transform
move_16 = Move(Geometry=pt_26, Motion=Z_7)  # -> Geometry, Transform
move_17 = Move(Geometry=pt_27, Motion=Z_8)  # -> Geometry, Transform
move_18 = Move(Geometry=pt_28, Motion=Z_9)  # -> Geometry, Transform
move_19 = Move(Geometry=move_15.Geometry, Motion=vec.Vector)  # -> Geometry, Transform
move_20 = Move(Geometry=move_16.Geometry, Motion=vec_2.Vector)  # -> Geometry, Transform
move_21 = Move(Geometry=move_17.Geometry, Motion=vec_3.Vector)  # -> Geometry, Transform
move_22 = Move(Geometry=move_18.Geometry, Motion=vec_4.Vector)  # -> Geometry, Transform
merge_3 = Merge(Data1=move_19.Geometry, Data2=move_20.Geometry, Data3=move_21.Geometry, Data4=move_22.Geometry, Data5=move_19.Geometry)
pline_4 = PolyLine(Vertices=merge_3, Closed=False)

# ---- group: Building mass
Z_10 = UnitZ(Factor=1)
roof = Curve(pline_4)
ground_floor = Curve(ground_floor_geometry)
loft = Loft(
    Curves=[ground_floor, roof],
    Options={Adjust=False, Closed=False, LoftEnds=0, LoftSimp=0, LoftType=0, Rebuild=10, Refit=0.01})
srf_7 = Surface(roof)
move_23 = Move(Geometry=srf_7, Motion=Z_10)  # -> Geometry, Transform
cap = CapHoles(Brep=loft)
loft_2 = Loft(
    Curves=[srf_7, move_23.Geometry],
    Options={Adjust=False, Closed=False, LoftEnds=0, LoftSimp=0, LoftType=0, Rebuild=10, Refit=0.01})
preview_6 = CustomPreview(Geometry=[cap, loft_2, move_23.Geometry], Material=ColourSwatch(SwatchColor=RGB(194, 251, 255)))

# ---- group: Luas
luas_lantai_dasar = Panel(panel)

# ---- group: Floors
building_mass = Brep(cap)
floor_height_3 = Number(floor_height)
contour = Contour(Shape=building_mass, Point=Point(0, 0, 0), Direction=Vector(0, 0, 1), Distance=floor_height_3)  # -> flatten(Contours)
area_3 = Area(Geometry=contour)  # -> Area, Centroid
ma = MassAddition(Input=area_3.Area)  # -> Result, PartialResults
panel_4 = Panel(area_3.Area)

# ----
pipe = Pipe(Curve=[contour, move_23.Geometry], Radius=0.2, Caps=0)  # disabled
preview_7 = CustomPreview(Geometry=pipe, Material=ColourSwatch(SwatchColor=RGB(0, 85, 128)))
total_area = Number(ma.Result)

total_area_2 = Number(total_area)
int = Integer(total_area_2)
panel_5 = Panel(int)

# ---- group: Luas (continued)
luas_total = Panel(panel_5)
num_3 = Number(luas_total)
luas_per_lantai = Panel(panel_4)

# ---- group: Floors (continued)
panel_6 = Panel(total_area)
